# Grasshopper definition GH_Challenges_E_representation.ghx (Grasshopper 0.9.76)
# plug-ins: ClipperComponents, HDTReference

# Grasshopper Challenges
# By Dan Taeyoung, 2016. https://github.com/provolot/GrasshopperChallenges
# Challenges E - Grasshopper as representation tool
# Challenge E1: We need to bake a sphere, but this 90s neon green will not do. Change the color and bake the sphere.
construct_point = ConstructPoint(XCoordinate=0, YCoordinate=0, ZCoordinate=0)
# Challenge E2: Great, but we need more fine-tuned control; change the color with the 'Colour RGB (f)' component and bake another sphere.
construct_point_2 = ConstructPoint(XCoordinate=50, YCoordinate=0, ZCoordinate=0)
# Challenge E3: We have ten spheres, but no reason why they should all be the same color. Add one 'Series' component and one 'Slider' to the Colour RGB (f) component, in order to create ten spheres that have all different colors. Bake them.
series = Series(Start=0, Step=Slider(33, range=0..100), Count=10)
construct_point_3 = ConstructPoint(XCoordinate=0, YCoordinate=0, ZCoordinate=0)
number_slider = Slider(10, range=0..10)
sphere = Sphere(Base=construct_point, Radius=Slider(8, range=0..100))
sphere_2 = Sphere(Base=construct_point_2, Radius=Slider(8, range=0..100))
colour_swatch = ColourSwatch(SwatchColor=RGB(106, 250, 0))
construct_point_4 = ConstructPoint(XCoordinate=100, YCoordinate=series, ZCoordinate=0)
geometry = Geometry(construct_point_3)
number_slider_2 = Slider(5, range=0..20)
rectangle = Rectangle(Plane=PlaneXY(0, 0, 0), XSize=number_slider, YSize=number_slider, Radius=0)  # -> Rectangle, Length

# ---- group: Notice the '(f)' after the name - that means that it receives 'floating point numbers' from 0.0 to 1.0
colour_rgb_f = ColourRGBF(Alpha=1, Red=Slider(1, range=0..1), Green=Slider(1, range=0..1), Blue=Slider(1, range=0..1))

# ---- group: This very similarly named component, without the '(f)', uses numbers from 0 to 255.
colour_rgb = ColourRGB(Alpha=255, Red=0, Green=0, Blue=0)

# ----
sphere_3 = Sphere(Base=construct_point_4, Radius=Slider(9, range=0..100))

# ---- group: Make sure to turn this back off! Otherwise any changes will continuously bake copies.
boolean_toggle = BooleanToggle(False)

# ----
custom_preview = CustomPreview(Geometry=sphere, Shader=colour_swatch)

# ---- group: Notice the '(f)' after the name - that means that it receives 'floating point numbers' from 0.0 to 1.0
colour_rgb_f_2 = ColourRGBF(Alpha=1, Red=Slider(1, range=0..1), Green=Slider(1, range=0..1), Blue=Slider(1, range=0..1))

# ----
rectangular_array = RectangularArray(Geometry=geometry, Cell=rectangle.Rectangle, XCount=number_slider_2, YCount=number_slider_2)  # -> Geometry, Transform
characters = Characters(Text="abcdefghijklmnopqrstuvwxyz")  # -> Result, Unicode
cluster = Cluster(number=Slider(3, range=0..10), B=Slider(44, range=0..100))

# ---- group: Make sure to turn this back off! Otherwise any changes will continuously bake copies.
boolean_toggle_2 = BooleanToggle(False)

boolean_toggle_3 = BooleanToggle(False)

# ----
list_length = ListLength(List=characters.Result)

# ---- group: This component is from http://www.giuliopiacentino.com/grasshopper-tools/.
# (There are actually many components in other plugins that do baking, including in Lunchbox, Human, Elefront among others. Giulio Piacentino's component works without a plugin.)
bakeattributes = CSharpScript(objs=sphere, colors=colour_swatch, activate=boolean_toggle)  # -> out; inputs objs: list, names: list of String, layers: list of String, colors: list of Color, pWidths: list of Double, wiresEach: list of Int32, materials: list, activate: Boolean, groupListTgthr: Boolean
# ---------- bakeattributes: C# ----------
    //Inserts geometry into the Rhino document, with custom attributes
    //Written by Giulio Piacentino
    //Version written 2011 10 18 - for Grasshopper 0.8.52

    if (activate)
    {
      int groupIndex = -1;
      if(groupListTgthr)
        groupIndex = doc.Groups.Add();

      for(int i = 0; i < objs.Count; i++)
      {
        object obj = objs[i];
        if(obj == null)
        {
          Print("No object to bake");
          return;
        }

        //Make new attribute to set name
        Rhino.DocObjects.ObjectAttributes att = new Rhino.DocObjects.ObjectAttributes();

        string name = names.Count > 0 ? names[i % names.Count] : null;
        //Set object name
        if(!string.IsNullOrEmpty(name))
        {
          att.Name = name;
        }

        Color color = colors.Count > 0 ? colors[i % colors.Count] : new Color();
        //Set color
        if(!color.IsEmpty)
        {
          att.ColorSource = Rhino.DocObjects.ObjectColorSource.ColorFromObject; //Make the color type "by object"
          att.ObjectColor = color;

          att.PlotColorSource = Rhino.DocObjects.ObjectPlotColorSource.PlotColorFromObject; //Make the plot color type "by object"
          att.PlotColor = color;
        }

        string layer = layers.Count > 0 ? layers[i % layers.Count] : null;
        //Set layer
        if(!string.IsNullOrEmpty(layer) && Rhino.DocObjects.Layer.IsValidName(layer))
        {
          //Get the current layer index
          Rhino.DocObjects.Tables.LayerTable layerTable = doc.Layers;
          int layerIndex = layerTable.Find(layer, true);

          if(layerIndex < 0) //This layer does not exist, we add it
          {
            Rhino.DocObjects.Layer onlayer = new Rhino.DocObjects.Layer(); //Make a new layer
            onlayer.Name = layer;

            layerIndex = layerTable.Add(onlayer); //Add the layer to the layer table
            if (layerIndex > -1) //We manged to add layer!
            {
              att.LayerIndex = layerIndex;
              Print("Added new layer to the document at position " + layerIndex + " named " + layer + ". ");
            } else
              Print("Layer did not add. Try cleaning up your layers."); //This never happened to me.
          }
          else
            att.LayerIndex = layerIndex; //We simply add to the existing layer
        }


        double pWidth = pWidths.Count > 0 ? pWidths[i % pWidths.Count] : 0;
        //Set plotweight
        if(pWidth > 0)
        {
          att.PlotWeightSource = Rhino.DocObjects.ObjectPlotWeightSource.PlotWeightFromObject;
          att.PlotWeight = pWidth;
        }


        object material = materials.Count > 0 ? materials[i % materials.Count] : null;
        //Set material
        bool materialByName = !string.IsNullOrEmpty(material as string);
        Rhino.Display.DisplayMaterial inMaterial = material as Rhino.Display.DisplayMaterial;
        if(material is Color)
        {
          inMaterial = new Rhino.Display.DisplayMaterial((Color) material);
        }
        if(material != null && inMaterial == null && !materialByName)
        {
          if(!(material is string))
          {
            try //We also resort to try with IConvertible
            {
              inMaterial = (Rhino.Display.DisplayMaterial) Convert.ChangeType(material, typeof(Rhino.Display.DisplayMaterial));
            }
            catch(InvalidCastException)
            {
            }
          }
        }
        if(inMaterial != null || materialByName)
        {
          string matName;

          if(!materialByName)
          {
            matName = string.Format("A:{0}-D:{1}-E:{2}-S:{3},{4}-T:{5}",
              Format(inMaterial.Ambient),
              Format(inMaterial.Diffuse),
              Format(inMaterial.Emission),
              Format(inMaterial.Specular),
              inMaterial.Shine.ToString(),
              inMaterial.Transparency.ToString()
              );
          }
          else
          {
            matName = (string) material;
          }

          int materialIndex = doc.Materials.Find(matName, true);
          if(materialIndex < 0 && !materialByName) //Material does not exist and we have its specs
          {
            materialIndex = doc.Materials.Add(); //Let's add it
            if(materialIndex > -1)
            {
              Print("Added new material at position " + materialIndex + " named \"" + matName + "\". ");
              Rhino.DocObjects.Material m = doc.Materials[materialIndex];
              m.Name = matName;
              m.AmbientColor = inMaterial.Ambient;
              m.DiffuseColor = inMaterial.Diffuse;
              m.EmissionColor = inMaterial.Emission;
              //m.ReflectionColor = no equivalent
              m.SpecularColor = inMaterial.Specular;
              m.Shine = inMaterial.Shine;
              m.Transparency = inMaterial.Transparency;
              //m.TransparentColor = no equivalent
              m.CommitChanges();

              att.MaterialSource = Rhino.DocObjects.ObjectMaterialSource.MaterialFromObject;
              att.MaterialIndex = materialIndex;
            }
            else
              Print("Material did not add. Try cleaning up your materials."); //This never happened to me.
          }
          else if(materialIndex < 0 && materialByName) //Material does not exist and we do not have its specs. We do nothing
          {
            Print("Warning: material name not found. I cannot set the source to this material name. Add a material with name: " + matName);
          }
          else
          {
            //If this material exists, we do not replace it!
            att.MaterialSource = Rhino.DocObjects.ObjectMaterialSource.MaterialFromObject;
            att.MaterialIndex = materialIndex;
          }
        }


        int wires = wiresEach.Count > 0 ? wiresEach[i % wiresEach.Count] : 0;
        //Set wire density
        if(wires == -1 || wires > 0)
        {
          att.WireDensity = wires;
        }

        Bake(obj, att, groupIndex);
      }
    }
    else
    {
      Print("Inactive");
    }
# ---------- bakeattributes: C# additional code ----------
  void Bake(object obj, Rhino.DocObjects.ObjectAttributes att, int groupIndex)
  {
    if(obj == null)
      return;

    Guid id;

    //Bake to the right type of object
    if(obj is GeometryBase)
    {
      GeometryBase geomObj = obj as GeometryBase;

      switch(geomObj.ObjectType)
      {
        case Rhino.DocObjects.ObjectType.Brep:
          id = doc.Objects.AddBrep(obj as Brep, att);
          break;
        case Rhino.DocObjects.ObjectType.Curve:
          id = doc.Objects.AddCurve(obj as Curve, att);
          break;
        case Rhino.DocObjects.ObjectType.Point:
          id = doc.Objects.AddPoint((obj as Rhino.Geometry.Point).Location, att);
          break;
        case Rhino.DocObjects.ObjectType.Surface:
          id = doc.Objects.AddSurface(obj as Surface, att);
          break;
        case Rhino.DocObjects.ObjectType.Mesh:
          id = doc.Objects.AddMesh(obj as Mesh, att);
          break;
        case (Rhino.DocObjects.ObjectType) 1073741824://Rhino.DocObjects.ObjectType.Extrusion:
          id = (Guid) typeof(Rhino.DocObjects.Tables.ObjectTable).InvokeMember("AddExtrusion", BindingFlags.Instance | BindingFlags.InvokeMethod, null, doc.Objects, new object[]{obj, att});
          break;
        case Rhino.DocObjects.ObjectType.PointSet:
          id = doc.Objects.AddPointCloud(obj as Rhino.Geometry.PointCloud, att); //This is a speculative entry
          break;
        default:
          Print("The script does not know how to handle this type of geometry: " + obj.GetType().FullName);
          return;
      }
    }
    else
    {
      Type objectType = obj.GetType();

      if(objectType == typeof(Arc))
      {
        id = doc.Objects.AddArc((Arc) obj, att);
      }
      else if(objectType == typeof(Box))
      {
        id = doc.Objects.AddBrep(((Box) obj).ToBrep(), att);
      }
      else if(objectType == typeof(Circle))
      {
        id = doc.Objects.AddCircle((Circle) obj, att);
      }
      else if(objectType == typeof(Ellipse))
      {
        id = doc.Objects.AddEllipse((Ellipse) obj, att);
      }
      else if(objectType == typeof(Polyline))
      {
        id = doc.Objects.AddPolyline((Polyline) obj, att);
      }
      else if(objectType == typeof(Sphere))
      {
        id = doc.Objects.AddSphere((Sphere) obj, att);
      }
      else if(objectType == typeof(Point3d))
      {
        id = doc.Objects.AddPoint((Point3d) obj, att);
      }
      else if(objectType == typeof(Line))
      {
        id = doc.Objects.AddLine((Line) obj, att);
      }
      else if(objectType == typeof(Vector3d))
      {
        Print("Impossible to bake vectors");
        return;
      }
      else if(obj is IEnumerable)
      {
        int newGroupIndex;
        if(groupIndex == -1)
          newGroupIndex = doc.Groups.Add();
        else
          newGroupIndex = groupIndex;
        foreach(object o in obj as IEnumerable)
        {
          Bake(o, att, newGroupIndex);
        }
        return;
      }
      else
      {
        Print("Unhandled type: " + objectType.FullName);
        return;
      }
    }

    if(groupIndex != -1)
    {
      doc.Groups.AddToGroup(groupIndex, id);
      Print("Added " + obj.GetType().Name + " to group number " + groupIndex);
    }
    else
      Print("Added " + obj.GetType().Name);
  }

  static string Format(Color c)
  {
    return (new System.Text.StringBuilder("A")).Append(c.A.ToString()).Append("R").Append(c.R.ToString()).Append("G")
      .Append(c.G.ToString()).Append("B").Append(c.B.ToString()).ToString();
  }
# ---------- end bakeattributes ----------

# ----
custom_preview_2 = CustomPreview(Geometry=sphere_2, Shader=colour_rgb_f)
list_length_2 = ListLength(List=rectangular_array.Geometry)
construct_domain = ConstructDomain(DomainStart=Slider(-13, range=-20..20), DomainEnd=Slider(8, range=-20..20))
panel = Panel(cluster)
custom_preview_3 = CustomPreview(Geometry=sphere_3, Shader=colour_rgb_f_2)
bakeattributes_2 = CSharpScript(objs=sphere_3, colors=colour_rgb_f_2, activate=boolean_toggle_3)  # -> out; inputs objs: list, names: list of String, layers: list of String, colors: list of Color, pWidths: list of Double, wiresEach: list of Int32, materials: list, activate: Boolean, groupListTgthr: Boolean; same code as bakeattributes
bakeattributes_3 = CSharpScript(objs=sphere_2, colors=colour_rgb_f, activate=boolean_toggle_2)  # -> out; inputs objs: list, names: list of String, layers: list of String, colors: list of Color, pWidths: list of Double, wiresEach: list of Int32, materials: list, activate: Boolean, groupListTgthr: Boolean; same code as bakeattributes
random = Random(Range=list_length, Number=list_length_2, Seed=2)
random_2 = Random(Range=construct_domain, Number=list_length_2, Seed=Slider(444, range=0..1000))
random_3 = Random(Range=construct_domain, Number=list_length_2, Seed=Slider(3434, range=0..10000))
list_item = ListItem(List=characters.Result, Index=random, Wrap=True)
vector_xyz = VectorXYZ(XComponent=random_3, YComponent=random_2, ZComponent=0)  # -> Vector, Length
point = Point(rectangular_array.Geometry)
panel_2 = Panel(list_item)
line_sdl = LineSDL(Start=point, Direction=vector_xyz.Vector, Length=vector_xyz.Length)
vector_display = VectorDisplay(Anchor=point, Vector=vector_xyz.Vector)
c_script = CSharpScript(face="Helvetica", bold=Toggle(True), italics=Toggle(False), size=Slider(18.35, range=0..21), content=panel_2, pl=point)  # -> out, A; inputs face: String, bold: Boolean, italics: Boolean, size: Double, content: String, pl: Plane
# ---------- c_script: C# ----------
    if(size == 0)
      size = 1;

    if(!string.IsNullOrEmpty(face) && size > 0 && !string.IsNullOrEmpty(content) &&
      pl.IsValid)
    {

      var te = RhinoDoc.ActiveDoc.Objects.AddText(content, pl, size, face, bold, italics);
      Rhino.DocObjects.TextObject txt = RhinoDoc.ActiveDoc.Objects.Find(te) as Rhino.DocObjects.TextObject;

      if(txt != null)
      {
        var tt = txt.Geometry as Rhino.Geometry.TextEntity;
        A = tt.Explode();
      }
      
      RhinoDoc.ActiveDoc.Objects.Delete(te, true);
    }
# ---------- end c_script ----------
graft_tree = GraftTree(Tree=line_sdl, IncludeEmptyLists=True, IncludeNullItems=True)
boundary_surfaces = BoundarySurfaces(Edges=c_script.A)
evaluate_length = EvaluateLength(Curve=graft_tree, Length=Slider(0.74, range=0..1), Normalized=True)  # -> Point, Tangent, Parameter
geometry_2 = Geometry(flatten(c_script.A))
shatter = Shatter(Curve=graft_tree, Parameters=evaluate_length.Parameter)
surface = Surface(flatten(boundary_surfaces))
end_points = EndPoints(Curve=graft_tree)  # -> Start, End
area = Area(Geometry=flatten(surface))  # -> Area, Centroid
point_2 = Point(point)
unit_z = UnitZ(Factor=1)
unit_z_2 = UnitZ(Factor=1)
list_item_2 = ListItem(List=shatter, Index=0, Wrap=True)
number_slider_3 = Slider(1.5, range=0..10)
vector_2pt = Vector2Pt(PointA=area.Centroid, PointB=point_2, Unitize=False)  # -> Vector, Length
rotate = Rotate(Vector=evaluate_length.Tangent, Axis=unit_z, Angle="Pi / 2")
rotate_2 = Rotate(Vector=evaluate_length.Tangent, Axis=unit_z_2, Angle="- Pi / 2")
move = Move(Geometry=surface, Motion=vector_2pt.Vector)  # -> Geometry, Transform
amplitude = Amplitude(Vector=rotate, Amplitude=number_slider_3)
amplitude_2 = Amplitude(Vector=rotate_2, Amplitude=number_slider_3)
move_2 = Move(Geometry=move.Geometry, Motion=vector_xyz.Vector)  # -> Geometry, Transform
move_3 = Move(Geometry=evaluate_length.Point, Motion=amplitude)  # -> Geometry, Transform
move_4 = Move(Geometry=evaluate_length.Point, Motion=amplitude_2)  # -> Geometry, Transform
vector_display_2 = VectorDisplay(Anchor=evaluate_length.Point, Vector=rotate)
merge = Merge(Data1=move_3.Geometry, Data2=move_4.Geometry, Data3=end_points.End)
geometry_3 = Geometry(simplify(graft(geometry_2)))
surface_2 = Surface(move_2.Geometry)
geometry_4 = Geometry(list_item_2)
geometry_5 = Geometry(geometry_3)
offset = Offset(Curve=geometry_3, Distance=Slider(0.5, range=0..1), Plane=PlaneXY(0, 0, 0), Corners=1)  # -> simplify(Curve)
polyline = PolyLine(Vertices=merge, Closed=Toggle(True))  # -> simplify(Polyline)
contour = Contour(Shape=graft(surface_2), Point=Point(0, 0, 0), Direction=graft(vector_xyz.Vector), Distance=Slider(1.36, range=0..4))
divide_length = DivideLength(Curve=geometry_4, Length=Slider(1.45, range=1..5))  # -> Points, Tangents, Parameters
merge_2 = Merge(Data1=geometry_3, Data2=offset)
colour_swatch_2 = ColourSwatch(SwatchColor=RGBA(219, 101, 0, 136))
createhatch = CreateHatch(Bake=False, Curves=geometry_3, HatchPatternName="Solid", HatchScale=1, HatchRotation=0, Attributes=colour_swatch_2)
polyline_offset = PolylineOffset(
    Polylines=list_item_2,
    Distance=Slider(0.15, range=0..1),
    Plane=Plane(origin=(0, 0, 0), x=(0, 0, 0), y=(0, 0, 0)),
    Tolerance=0.01,
    ClosedFillet=1,
    OpenFillet=1,
    Miter=2)  # -> simplify(Contour), Holes
geometry_6 = Geometry(contour)
circle = Circle(Plane=divide_length.Points, Radius=Slider(0.5, range=0..1))  # -> simplify(Circle)
polyline_offset_2 = PolylineOffset(
    Polylines=geometry_6,
    Distance=Slider(0.2, range=0..1),
    Plane=Plane(origin=(0, 0, 0), x=(0, 0, 0), y=(0, 0, 0)),
    Tolerance=0.01,
    ClosedFillet=1,
    OpenFillet=1,
    Miter=2)  # -> Contour, Holes
custom_preview_4 = CustomPreview(Geometry=createhatch, Shader=colour_swatch_2)
hatch_table = HatchTable(Update=True)
colour_swatch_3 = ColourSwatch(SwatchColor=RGBA(89, 185, 172, 69))
boolean_toggle_4 = BooleanToggle(False)
colour_swatch_4 = ColourSwatch(SwatchColor=RGB(253, 242, 255))
geometry_7 = Geometry([circle, polyline])
panel_3 = Panel(createhatch)
material_table = MaterialTable(Update=True)  # -> MaterialName, Shader, Diffuse, Specular, Emission, Alpha, Gloss
createattributes = CreateAttributes(LayerName="letters", Color=colour_swatch_3, enableFullPath=False)
createattributes_2 = CreateAttributes(LayerName="arrows", Color=colour_swatch_4, enableFullPath=False)
createhatch_2 = CreateHatch(
    Bake=boolean_toggle_4,
    Curves=geometry_7,
    HatchPatternName="Solid",
    HatchScale=1,
    HatchRotation=0,
    Attributes=createattributes_2)
createhatch_3 = CreateHatch(
    Bake=boolean_toggle_4,
    Curves=polyline_offset_2.Contour,
    HatchPatternName="Solid",
    HatchScale=1,
    HatchRotation=0,
    Attributes=createattributes)
custom_preview_5 = CustomPreview(Geometry=polyline_offset_2.Contour, Shader=colour_swatch_3)
custom_preview_6 = CustomPreview(Geometry=createhatch_2, Shader=colour_swatch_4)

# ==== cluster Cluster
number = ClusterInput()
B = ClusterInput()
number_2 = Number(number)
addition = Addition(A=number_2, B=B)
division = Division(A=number_2, B=addition)
result = ClusterOutput(division)
