# Grasshopper definition GH_Tutorials_H_GettingDataInAndOut.ghx (Grasshopper 1.0.7)
# plug-ins: Swiftlet, jSwan, Heron

# ---- group: Citibike Station data - this is older, archived data from 2016!
# Getting data in/out of Grasshopper
# Using Python to do a GET request and parse JSON!
panel = Panel("http://feeds.citibikenyc.com/stations/stations.json")

# ---- group: Citibike Station data - up to date (as of July 2022)
panel_2 = Panel("https://gbfs.citibikenyc.com/gbfs/en/station_status.json")

# ----
panel_3 = Panel("https://gbfs.citibikenyc.com/gbfs/en/station_information.json")
# Saving Grasshopper Data!
# Okay --- this is super funky.
# You can save any kind of geometry with Grasshopper to a file!
# 
# And even more interestingly, Grasshopper will auto-load this.
# 
# This means that you can have Grasshopper sharing data between instances of Rhino..
# 
# Or, if you use Dropbox / Google Drive or some other auto-syncing mechanism, you can easily share data over the network!
number_slider = Slider(6, range=0..10)
# Saving text files!
# You can save files with Python.. but you can also use Grasshopper.
number_slider_2 = Slider(4, range=0..10)
boolean_toggle = BooleanToggle(True)
series = Series(Start=number_slider, Step=1, Count=Slider(10, range=0..100))
# Reading text files!
file_path = FilePath("C:\Users\provolot\github\PaperHopper_metatool\.gitignore")
series_2 = Series(Start=number_slider_2, Step=1, Count=Slider(10, range=0..100))
panel_4 = Panel(file_path)
stream_filter = StreamFilter(Gate=boolean_toggle, Stream1=panel_3)
stream_filter_2 = StreamFilter(Gate=boolean_toggle, Stream1=panel_2)

# ---- group: This is the component that does the JSON reading.
getjson = PythonScript(URL=panel, Activate=Toggle(False))  # -> data, JSON, PathStructure, IDs, Values; inputs Activate: Boolean
# ---------- getjson: Python ----------
import json
import array
import urllib2
import rhinoscriptsyntax as rs
import clr
import Grasshopper
from Grasshopper.Kernel.Data import GH_Path
from Grasshopper import DataTree

def traverseJson(fragment, thispath, prevkey, toReturn):
    thistext = ""
    if(type(fragment) == dict):
        for i in xrange(len(fragment.keys())):
            thispath.append(i)
            thiskey = fragment.keys()[i]
            thistext += traverseJson(fragment[thiskey], thispath, thiskey, toReturn)
            thispath.pop()
        return thistext
    if(type(fragment) == list):
        for i in xrange(len(fragment)):
            thispath.append(i)
            thistext += traverseJson(fragment[i], thispath, prevkey, toReturn)
            thispath.pop()
        return thistext    
        
        
    if(fragment != None):
        if(toReturn == "paths"):
            return unicode(thispath) + "\n"
        if(toReturn == "ids"):
            return prevkey + "\n"
        if(toReturn == "values"):
            return unicode(fragment) + "\n"
        
    else:
        return ""
    
    
def JSONtoTREE(json):
    global PathStructure
    global IDs
    global Values
    
    IDtree = DataTree[object]()
    Valuetree = DataTree[object]()
    
    path = []
    
    PathStructure = traverseJson(json, path, "", "paths").splitlines();
    IDs = traverseJson(json, path, "", "ids").splitlines()
    Values = traverseJson(json, path, "", "values").splitlines()
    NewPathStructure = []
    for i in xrange(len(PathStructure)):
        thispath = PathStructure[i]
        thispath = map(lambda x: int(x), thispath.replace("]","").replace("[","").split(","))
        #print GH_Path(thispath
        newarray = array.array('i')
        newarray.fromlist(thispath)
        IDtree.Add(IDs[i], GH_Path(*newarray))
        Valuetree.Add(Values[i], GH_Path(*newarray))
        
    IDs = IDtree
    Values = Valuetree
    
    return str(json)
    

if(Activate == True):
    
    if URL:
        data = urllib2.urlopen(URL).read()
        data = json.loads(data)
      
        JSON = JSONtoTREE(data)
        
    else:
        if Path:
            
            file = open(Path)
            data = json.load(file)
            JSON = JSONtoTREE(data)
            
        else:
            if Text:
                data = json.loads(Text)
                JSON = JSONtoTREE(data)
# ---------- end getjson ----------

# ----
panel_5 = Panel(series)
# Change this and watch this change!
read_file = ReadFile(File=file_path, PerLineParse=True)
sphere = Sphere(Base=PlaneXY(0, 0, 0), Radius=Slider(3, range=0..10))
# Right click and select "Stream Destination" to select location..
# 
# Then right click again and toggle "Stream Contents" to start saving data to a file. Untoggle this to stop.
panel_6 = Panel(series_2)

# ---- group: This is from Swiftlet, a library that allows HTTP web requests
get_request = GETRequest(URL=stream_filter_2)  # -> Status, Content, Response
get_request_2 = GETRequest(URL=stream_filter)  # -> Status, Content, Response

# ----
trim_tree = TrimTree(Tree=getjson.IDs, Depth=1)
trim_tree_2 = TrimTree(Tree=getjson.Values, Depth=1)
panel_7 = Panel(read_file)
data_output = DataOutput(
    somedata=panel_5,
    somegeo=sphere,
    Destination="\Dropbox\RMIT Teaching\2019 COMS 2\Downloads\test1.ghdata",
    RelativePath="\Dropbox\RMIT Teaching\2019 COMS 2\Downloads\test1.ghdata")
simplify_tree = SimplifyTree(Tree=trim_tree, Front=False)

# ---- group: This is from Jswan, a library that allows easy navigation of JSON data
deserialize_json = DeserializeJson(JSON=get_request_2.Content, OutputsLocked=False)  # -> Data, Last_updated, Ttl
deserialize_json_2 = DeserializeJson(JSON=get_request.Content, OutputsLocked=False)  # -> Data, Last_updated, Ttl
deserialize_json_3 = DeserializeJson(JSON=deserialize_json.Data, OutputsLocked=False)
deserialize_json_4 = DeserializeJson(JSON=deserialize_json_2.Data, OutputsLocked=False)
deserialize_json_5 = DeserializeJson(JSON=deserialize_json_3, OutputsLocked=False)  # -> Station_id, Station_type, Lon, Eightd_station_services, Name, External_id, Electric_bike_surcharge_waiver, Eightd_has_key_dispenser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
deserialize_json_6 = DeserializeJson(JSON=deserialize_json_4, OutputsLocked=False)  # -> Num_bikes_disabled, Num_bikes_available, Is_installed, Station_status, Is_returning, Is_renting, Eightd_has_available_keys, Legacy_id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

# ----
panel_8 = Panel(simplify_tree)
list_item = ListItem(List=trim_tree_2, Index=Slider(6, range=0..10), Wrap=True)
list_item_2 = ListItem(List=trim_tree_2, Index=Slider(2, range=0..10), Wrap=True)
# In this example, we're simply converting latitude to X coordinates, and longitude to Y coordinates. This isn't accurate, but good enough for this example, just to visualize data.
construct_point = ConstructPoint(XCoordinate=list_item_2, YCoordinate=list_item, ZCoordinate=0)
# You can right-click to set the name of the input file. You can also set the delay, so that file changes aren't reflected immediately.
data_input = DataInput(
    Destination="\Dropbox\RMIT Teaching\2019 COMS 2\Downloads\test1.ghdata",
    RelativePath="\Dropbox\RMIT Teaching\2019 COMS 2\Downloads\test1.ghdata",
    UpdateDelay=50000)  # -> somedata, somegeo
list_item_3 = ListItem(List=trim_tree_2, Index=Slider(14, range=0..100), Wrap=True)  # -> Item, Item1
panel_9 = Panel(data_input.somedata)
panel_10 = Panel(data_input.somegeo)
number = Number(deserialize_json_5.Station_id)
number_2 = Number(deserialize_json_6.Station_id)
decimal_degrees_to_xy = DecimalDegreesToXY(Latitude=deserialize_json_5.Lat, Longitude=deserialize_json_5.Lon)  # -> flatten(XyPoint), Transform
panel_11 = Panel(deserialize_json_6.Station_id)
member_index = MemberIndex(Set=number_2, Member=number)  # -> Index, Count
cone = Cone(Base=construct_point, Radius=Slider(0.003, range=0..0.1), Length=Slider(0.007, range=0..0.01))  # -> Cone, Tip
power_of_10 = PowerOf10(Value=Slider(6, range=0..10))
list_item_4 = ListItem(List=deserialize_json_6.Num_bikes_available, Index=member_index.Index, Wrap=True)  # -> flatten(Item)
custom_preview = CustomPreview(Geometry=cone.Cone, Material=ColourSwatch(SwatchColor=RGB(103, 221, 235)))
division = Division(A=decimal_degrees_to_xy.XyPoint, B=power_of_10)
panel_12 = Panel(division)
panel_13 = Panel(trim_tree_2)
bounds = Bounds(Numbers=list_item_4)
deconstruct_domain = DeconstructDomain(Domain=bounds)  # -> Start, End
ghpython_script = GhPythonScript(x=Slider(7, range=0..10))  # -> out, a
# ---------- ghpython_script: Python ----------
from scriptcontext import sticky

sticky["test"] = x
# ---------- end ghpython_script ----------
ghpython_script_2 = GhPythonScript(x=Slider(5, range=0..10))  # -> result, out
# ---------- ghpython_script_2: Python ----------
from scriptcontext import sticky


result = sticky["test"]
# ---------- end ghpython_script_2 ----------
panel_14 = Panel(ghpython_script_2.result)
panel_15 = Panel(ghpython_script.a)
unit_z = UnitZ(Factor=Slider(0.127, range=0..0.2))
gradient = Gradient(
    LowerLimit=deconstruct_domain.Start,
    UpperLimit=deconstruct_domain.End,
    Parameter=list_item_4,
    stops=[0: RGB(255, 0, 157), 0.127: RGB(255, 217, 0), 0.302: RGB(0, 111, 196)])
move = Move(Geometry=division, Motion=unit_z)  # -> Geometry, Transform
xz_plane = XZPlane(Origin=move.Geometry)
text_tag_3d = TextTag3D(
    Location=xz_plane,
    Text=list_item_4,
    Size=Slider(0.1, range=0..1),
    Colour=ColourSwatch(SwatchColor=RGB(255, 254, 254)),
    Justification=8)
dot_display = DotDisplay(Point=division, Colour=gradient, Size=Slider(0.1, range=0..1))
